# Grasshopper definition tests.gh (Grasshopper 1.0.8)
# Copyright: GNU Lesser General Public License Version 3
# plug-ins: RhinoCodePluginGH, Hops, semio

dir = Directory()  # -> D
# ---------- dir: C# ----------
#region Usings
using System;
using System.Linq;
using System.Collections;
using System.Collections.Generic;
using System.Drawing;
using System.IO;

using Rhino;
using Rhino.Geometry;

using Grasshopper;
using Grasshopper.Kernel;
using Grasshopper.Kernel.Data;
using Grasshopper.Kernel.Types;
#endregion

public class Script_Instance : GH_ScriptInstance
{
    private void RunScript(ref object D)
    {
        D = Path.GetDirectoryName(this.GrasshopperDocument.FilePath);
    }
}
# ---------- end dir ----------
sep = Separator()  # -> S
# ---------- sep: C# ----------
#region Usings
using System;
using System.Linq;
using System.Collections;
using System.Collections.Generic;
using System.Drawing;
using System.IO;

using Rhino;
using Rhino.Geometry;

using Grasshopper;
using Grasshopper.Kernel;
using Grasshopper.Kernel.Data;
using Grasshopper.Kernel.Types;
#endregion

public class Script_Instance : GH_ScriptInstance
{
    private void RunScript(ref object S)
    {
        S = Path.DirectorySeparatorChar;
    }
}
# ---------- end sep ----------
par = ParentDirectory(D=dir)  # -> P; inputs D: String
# ---------- par: C# ----------
#region Usings
using System;
using System.Linq;
using System.Collections;
using System.Collections.Generic;
using System.Drawing;
using System.IO;

using Rhino;
using Rhino.Geometry;

using Grasshopper;
using Grasshopper.Kernel;
using Grasshopper.Kernel.Data;
using Grasshopper.Kernel.Types;
#endregion

public class Script_Instance : GH_ScriptInstance
{
    private void RunScript(string D, ref object P)
    {
        P = new DirectoryInfo(D).Parent;
    }
}
# ---------- end par ----------
concat = Concatenate(FragmentA=dir, FragmentD=sep, FragmentB="local")
par_2 = ParentDirectory(D=par)  # -> P; inputs D: String; same code as par
concat_2 = Concatenate(FragmentA=concat, FragmentC=sep, FragmentE="kit")
concat_3 = Concatenate(FragmentA=concat, FragmentD=sep, FragmentC="ai")
concat_4 = Concatenate(FragmentA=par_2, FragmentB=sep, FragmentC="examples")
concat_5 = Concatenate(FragmentA=concat_4, FragmentB=sep, FragmentC="metabolism")

concat_6 = Concatenate(FragmentA=concat_4, FragmentB=sep, FragmentC="metabolism")
concat_7 = Concatenate(FragmentA=concat_6, FragmentB=sep, FragmentC="designs")
concat_8 = Concatenate(FragmentA=concat_7, FragmentB=sep, FragmentC="nakagin-capsule-tower", FragmentD=".gh")
item = ListItem(List=concat_8, Index=0, Wrap=True)
toggle = BooleanToggle(True)
hops = Hops(
    _Path=item,
    _Enabled=toggle,
    CacheResultsInMemory=True,
    CacheSolveResults=True,
    RemoteDefinitionLocation="C:\git\semio\examples\metabolism\designs\nakagin-capsule-tower.gh",
    RemoteSolveVersion=(0, 1, 0),
    ShowInput_Enabled=True,
    ShowInput_Path=True,
    SynchronousSolve=False)
hops_2 = Hops(
    _Path=item,
    _Enabled=toggle,
    Variant="Slanted",
    CacheResultsInMemory=True,
    CacheSolveResults=True,
    RemoteDefinitionLocation="C:\git\semio\examples\metabolism\designs\nakagin-capsule-tower.gh",
    RemoteSolveVersion=(0, 1, 0),
    ShowInput_Enabled=True,
    ShowInput_Path=True,
    SynchronousSolve=False)
hops_3 = Hops(
    _Path=item,
    _Enabled=toggle,
    Variant="Twisted",
    CacheResultsInMemory=True,
    CacheSolveResults=True,
    RemoteDefinitionLocation="C:\git\semio\examples\metabolism\designs\nakagin-capsule-tower.gh",
    RemoteSolveVersion=(0, 1, 0),
    ShowInput_Enabled=True,
    ShowInput_Path=True,
    SynchronousSolve=False)
hops_4 = Hops(
    _Path=item,
    _Enabled=toggle,
    Variant="Dancing",
    View="Explosion Axonometry",
    CacheResultsInMemory=True,
    CacheSolveResults=True,
    RemoteDefinitionLocation="C:\git\semio\examples\metabolism\designs\nakagin-capsule-tower.gh",
    RemoteSolveVersion=(0, 1, 0),
    ShowInput_Enabled=True,
    ShowInput_Path=True,
    SynchronousSolve=False)
merge = Merge(Data1=hops, Data2=hops_2, Data3=hops_3, Data4=hops_4)
merge_2 = Merge(Data1=merge)
txt = DecodeText(EncodedText=merge_2)
dsn = DeserializeDesign(Text=txt)
dn = Design(dsn)
list = ValueList({"Dsn(Nakagin Capsule Tower)": 0, "Dsn(Nakagin Capsule Tower,Slanted)": 1, "Dsn(Nakagin Capsule Tower,Twisted)": 2, "Dsn(Nakagin Capsule Tower,Dancing,Explosion Axonometry)": 3}, selected="Dsn(Nakagin Capsule Tower)")
dn_2 = Design([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])
lng = ListLength(List=dn_2)
series = Series(Start=0, Step=1, Count=lng)
concat_9 = Concatenate(FragmentA=dn_2, FragmentC="=", FragmentB=series)
panel = Panel(concat_9)

panel_2 = Panel("""base
blob-base
bridge
capital
capsule-with-balcony
capsule
cylindric-capital
cylindric-tambour
ellipsoid-capsule
tambour
trapezoid-capsule""")
concat_10 = Concatenate(FragmentA=concat_5, FragmentB=sep, FragmentC="types")
concat_11 = Concatenate(FragmentA=concat_10, FragmentB=sep, FragmentC=panel_2, FragmentD=".gh")
toggle_2 = BooleanToggle(True)  # disabled
toggle_3 = BooleanToggle(True)
item_2 = ListItem(List=concat_11, Index=0, Wrap=True)  # -> Item, Item1, Item2, Item3, Item4, Item5, Item6, Item7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
hops_5 = Hops(
    _Path=item_2.Item4,
    _Enabled=toggle_3,
    Variant="\",
    CacheResultsInMemory=True,
    CacheSolveResults=True,
    RemoteDefinitionLocation="C:\git\semio\examples\metabolism\types\capsule-with-balcony.gh",
    RemoteSolveVersion=(0, 1, 0),
    ShowInput_Enabled=True,
    ShowInput_Path=True,
    SynchronousSolve=False)
hops_6 = Hops(
    _Path=item_2.Item5,
    _Enabled=toggle_3,
    Variant="\",
    CacheResultsInMemory=True,
    CacheSolveResults=True,
    RemoteDefinitionLocation="C:\git\semio\examples\metabolism\types\capsule.gh",
    RemoteSolveVersion=(0, 1, 0),
    ShowInput_Enabled=True,
    ShowInput_Path=True,
    SynchronousSolve=False)
hops_7 = Hops(
    _Path=item_2.Item8,
    _Enabled=toggle_3,
    Variant="\",
    CacheResultsInMemory=True,
    CacheSolveResults=True,
    RemoteDefinitionLocation="C:\git\semio\examples\metabolism\types\ellipsoid-capsule.gh",
    RemoteSolveVersion=(0, 1, 0),
    ShowInput_Enabled=True,
    ShowInput_Path=True,
    SynchronousSolve=False)
hops_8 = Hops(
    _Path=item_2.Item10,
    _Enabled=toggle_3,
    Variant="\",
    CacheResultsInMemory=True,
    CacheSolveResults=True,
    RemoteDefinitionLocation="C:\git\semio\examples\metabolism\types\trapezoid-capsule.gh",
    RemoteSolveVersion=(0, 1, 0),
    ShowInput_Enabled=True,
    ShowInput_Path=True,
    SynchronousSolve=False)
hops_9 = Hops(
    _Path=item_2.Item9,
    _Enabled=toggle_3,
    CacheResultsInMemory=True,
    CacheSolveResults=True,
    RemoteDefinitionLocation="C:\git\semio\examples\metabolism\types\tambour.gh",
    RemoteSolveVersion=(0, 1, 0),
    ShowInput_Enabled=True,
    ShowInput_Path=True,
    SynchronousSolve=False)
hops_10 = Hops(
    _Path=item_2.Item7,
    _Enabled=toggle_3,
    CacheResultsInMemory=True,
    CacheSolveResults=True,
    RemoteDefinitionLocation="C:\git\semio\examples\metabolism\types\cylindric-tambour.gh",
    RemoteSolveVersion=(0, 1, 0),
    ShowInput_Enabled=True,
    ShowInput_Path=True,
    SynchronousSolve=False)
hops_11 = Hops(
    _Path=item_2.Item9,
    _Enabled=toggle_3,
    Variant="First Storey",
    CacheResultsInMemory=True,
    CacheSolveResults=True,
    RemoteDefinitionLocation="C:\git\semio\examples\metabolism\types\tambour.gh",
    RemoteSolveVersion=(0, 1, 0),
    ShowInput_Enabled=True,
    ShowInput_Path=True,
    SynchronousSolve=False)
hops_12 = Hops(
    _Path=item_2.Item7,
    _Enabled=toggle_3,
    Variant="First Storey",
    CacheResultsInMemory=True,
    CacheSolveResults=True,
    RemoteDefinitionLocation="C:\git\semio\examples\metabolism\types\cylindric-tambour.gh",
    RemoteSolveVersion=(0, 1, 0),
    ShowInput_Enabled=True,
    ShowInput_Path=True,
    SynchronousSolve=False)
txt_2 = DecodeText(EncodedText=hops_9)  # disabled
hops_13 = Hops(
    _Path=item_2.Item4,
    _Enabled=toggle_3,
    Variant="/",
    CacheResultsInMemory=True,
    CacheSolveResults=True,
    RemoteDefinitionLocation="C:\git\semio\examples\metabolism\types\capsule-with-balcony.gh",
    RemoteSolveVersion=(0, 1, 0),
    ShowInput_Enabled=True,
    ShowInput_Path=True,
    SynchronousSolve=False)
hops_14 = Hops(
    _Path=item_2.Item5,
    _Enabled=toggle_3,
    Variant="/",
    CacheResultsInMemory=True,
    CacheSolveResults=True,
    RemoteDefinitionLocation="C:\git\semio\examples\metabolism\types\capsule.gh",
    RemoteSolveVersion=(0, 1, 0),
    ShowInput_Enabled=True,
    ShowInput_Path=True,
    SynchronousSolve=False)
hops_15 = Hops(
    _Path=item_2.Item8,
    _Enabled=toggle_3,
    Variant="/",
    CacheResultsInMemory=True,
    CacheSolveResults=True,
    RemoteDefinitionLocation="C:\git\semio\examples\metabolism\types\ellipsoid-capsule.gh",
    RemoteSolveVersion=(0, 1, 0),
    ShowInput_Enabled=True,
    ShowInput_Path=True,
    SynchronousSolve=False)
hops_16 = Hops(
    _Path=item_2.Item10,
    _Enabled=toggle_3,
    Variant="/",
    CacheResultsInMemory=True,
    CacheSolveResults=True,
    RemoteDefinitionLocation="C:\git\semio\examples\metabolism\types\trapezoid-capsule.gh",
    RemoteSolveVersion=(0, 1, 0),
    ShowInput_Enabled=True,
    ShowInput_Path=True,
    SynchronousSolve=False)
typ = DeserializeType(Text=txt_2)  # disabled
hops_17 = Hops(
    _Path=item_2.Item9,
    _Enabled=toggle_3,
    Variant="Last Storey",
    CacheResultsInMemory=True,
    CacheSolveResults=True,
    RemoteDefinitionLocation="C:\git\semio\examples\metabolism\types\tambour.gh",
    RemoteSolveVersion=(0, 1, 0),
    ShowInput_Enabled=True,
    ShowInput_Path=True,
    SynchronousSolve=False)
hops_18 = Hops(
    _Path=item_2.Item4,
    _Enabled=toggle_3,
    Variant="q",
    CacheResultsInMemory=True,
    CacheSolveResults=True,
    RemoteDefinitionLocation="C:\git\semio\examples\metabolism\types\capsule-with-balcony.gh",
    RemoteSolveVersion=(0, 1, 0),
    ShowInput_Enabled=True,
    ShowInput_Path=True,
    SynchronousSolve=False)
hops_19 = Hops(
    _Path=item_2.Item7,
    _Enabled=toggle_3,
    Variant="Last Storey",
    CacheResultsInMemory=True,
    CacheSolveResults=True,
    RemoteDefinitionLocation="C:\git\semio\examples\metabolism\types\cylindric-tambour.gh",
    RemoteSolveVersion=(0, 1, 0),
    ShowInput_Enabled=True,
    ShowInput_Path=True,
    SynchronousSolve=False)
hops_20 = Hops(
    _Path=item_2.Item5,
    _Enabled=toggle_3,
    Variant="q",
    CacheResultsInMemory=True,
    CacheSolveResults=True,
    RemoteDefinitionLocation="C:\git\semio\examples\metabolism\types\capsule.gh",
    RemoteSolveVersion=(0, 1, 0),
    ShowInput_Enabled=True,
    ShowInput_Path=True,
    SynchronousSolve=False)
hops_21 = Hops(
    _Path=item_2.Item8,
    _Enabled=toggle_3,
    Variant="q",
    CacheResultsInMemory=True,
    CacheSolveResults=True,
    RemoteDefinitionLocation="C:\git\semio\examples\metabolism\types\ellipsoid-capsule.gh",
    RemoteSolveVersion=(0, 1, 0),
    ShowInput_Enabled=True,
    ShowInput_Path=True,
    SynchronousSolve=False)
hops_22 = Hops(
    _Path=item_2.Item10,
    _Enabled=toggle_3,
    Variant="q",
    CacheResultsInMemory=True,
    CacheSolveResults=True,
    RemoteDefinitionLocation="C:\git\semio\examples\metabolism\types\trapezoid-capsule.gh",
    RemoteSolveVersion=(0, 1, 0),
    ShowInput_Enabled=True,
    ShowInput_Path=True,
    SynchronousSolve=False)
ty = Type(graft(typ))  # disabled
typ_2 = ModelType(Type=ty, Validate=toggle_2)  # -> Type, Valid, Name, Description, Icon, Image, flatten(Variant), Unit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; disabled
hops_23 = Hops(
    _Path=item_2.Item4,
    _Enabled=toggle_3,
    Variant="p",
    CacheResultsInMemory=True,
    CacheSolveResults=True,
    RemoteDefinitionLocation="C:\git\semio\examples\metabolism\types\capsule-with-balcony.gh",
    RemoteSolveVersion=(0, 1, 0),
    ShowInput_Enabled=True,
    ShowInput_Path=True,
    SynchronousSolve=False)
hops_24 = Hops(
    _Path=item_2.Item5,
    _Enabled=toggle_3,
    Variant="p",
    CacheResultsInMemory=True,
    CacheSolveResults=True,
    RemoteDefinitionLocation="C:\git\semio\examples\metabolism\types\capsule.gh",
    RemoteSolveVersion=(0, 1, 0),
    ShowInput_Enabled=True,
    ShowInput_Path=True,
    SynchronousSolve=False)
hops_25 = Hops(
    _Path=item_2.Item8,
    _Enabled=toggle_3,
    Variant="p",
    CacheResultsInMemory=True,
    CacheSolveResults=True,
    RemoteDefinitionLocation="C:\git\semio\examples\metabolism\types\ellipsoid-capsule.gh",
    RemoteSolveVersion=(0, 1, 0),
    ShowInput_Enabled=True,
    ShowInput_Path=True,
    SynchronousSolve=False)
hops_26 = Hops(
    _Path=item_2.Item10,
    _Enabled=toggle_3,
    Variant="p",
    CacheResultsInMemory=True,
    CacheSolveResults=True,
    RemoteDefinitionLocation="C:\git\semio\examples\metabolism\types\trapezoid-capsule.gh",
    RemoteSolveVersion=(0, 1, 0),
    ShowInput_Enabled=True,
    ShowInput_Path=True,
    SynchronousSolve=False)
hops_27 = Hops(
    _Path=item_2.Item9,
    _Enabled=toggle_3,
    Variant="Single Storey",
    CacheResultsInMemory=True,
    CacheSolveResults=True,
    RemoteDefinitionLocation="C:\git\semio\examples\metabolism\types\tambour.gh",
    RemoteSolveVersion=(0, 1, 0),
    ShowInput_Enabled=True,
    ShowInput_Path=True,
    SynchronousSolve=False)
hops_28 = Hops(
    _Path=item_2.Item7,
    _Enabled=toggle_3,
    Variant="Single Storey",
    CacheResultsInMemory=True,
    CacheSolveResults=True,
    RemoteDefinitionLocation="C:\git\semio\examples\metabolism\types\cylindric-tambour.gh",
    RemoteSolveVersion=(0, 1, 0),
    ShowInput_Enabled=True,
    ShowInput_Path=True,
    SynchronousSolve=False)
hops_29 = Hops(
    _Path=item_2.Item,
    _Enabled=toggle_3,
    Variant="\"\"",
    CacheResultsInMemory=True,
    CacheSolveResults=True,
    RemoteDefinitionLocation="C:\git\semio\examples\metabolism\types\base.gh",
    RemoteSolveVersion=(0, 1, 0),
    ShowInput_Enabled=True,
    ShowInput_Path=True,
    SynchronousSolve=False)
hops_30 = Hops(
    _Path=item_2.Item1,
    _Enabled=toggle_3,
    Variant="\"Blob\"",
    CacheResultsInMemory=True,
    CacheSolveResults=True,
    RemoteDefinitionLocation="C:\git\semio\examples\metabolism\types\blob-base.gh",
    RemoteSolveVersion=(0, 1, 0),
    ShowInput_Enabled=True,
    ShowInput_Path=True,
    SynchronousSolve=False)
hops_31 = Hops(
    _Path=item_2.Item2,
    _Enabled=toggle_3,
    CacheResultsInMemory=True,
    CacheSolveResults=True,
    RemoteDefinitionLocation="C:\git\semio\examples\metabolism\types\bridge.gh",
    RemoteSolveVersion=(0, 1, 0),
    ShowInput_Enabled=True,
    ShowInput_Path=True,
    SynchronousSolve=False)
hops_32 = Hops(
    _Path=item_2.Item3,
    _Enabled=toggle_3,
    CacheResultsInMemory=True,
    CacheSolveResults=True,
    RemoteDefinitionLocation="C:\git\semio\examples\metabolism\types\capital.gh",
    RemoteSolveVersion=(0, 1, 0),
    ShowInput_Enabled=True,
    ShowInput_Path=True,
    SynchronousSolve=False)
hops_33 = Hops(
    _Path=item_2.Item6,
    _Enabled=toggle_3,
    CacheResultsInMemory=True,
    CacheSolveResults=True,
    RemoteDefinitionLocation="C:\git\semio\examples\metabolism\types\cylindric-capital.gh",
    RemoteSolveVersion=(0, 1, 0),
    ShowInput_Enabled=True,
    ShowInput_Path=True,
    SynchronousSolve=False)
trim = TrimTree(Tree=typ_2.Ports, Depth=1)  # disabled
merge_3 = Merge(Data1=hops_9, Data2=hops_11, Data3=hops_17, Data4=hops_27)
hops_34 = Hops(
    _Path=item_2.Item4,
    _Enabled=toggle_3,
    Variant="J",
    CacheResultsInMemory=True,
    CacheSolveResults=True,
    RemoteDefinitionLocation="C:\git\semio\examples\metabolism\types\capsule-with-balcony.gh",
    RemoteSolveVersion=(0, 1, 0),
    ShowInput_Enabled=True,
    ShowInput_Path=True,
    SynchronousSolve=False)
hops_35 = Hops(
    _Path=item_2.Item5,
    _Enabled=toggle_3,
    Variant="J",
    CacheResultsInMemory=True,
    CacheSolveResults=True,
    RemoteDefinitionLocation="C:\git\semio\examples\metabolism\types\capsule.gh",
    RemoteSolveVersion=(0, 1, 0),
    ShowInput_Enabled=True,
    ShowInput_Path=True,
    SynchronousSolve=False)
hops_36 = Hops(
    _Path=item_2.Item8,
    _Enabled=toggle_3,
    Variant="J",
    CacheResultsInMemory=True,
    CacheSolveResults=True,
    RemoteDefinitionLocation="C:\git\semio\examples\metabolism\types\ellipsoid-capsule.gh",
    RemoteSolveVersion=(0, 1, 0),
    ShowInput_Enabled=True,
    ShowInput_Path=True,
    SynchronousSolve=False)
hops_37 = Hops(
    _Path=item_2.Item10,
    _Enabled=toggle_3,
    Variant="J",
    CacheResultsInMemory=True,
    CacheSolveResults=True,
    RemoteDefinitionLocation="C:\git\semio\examples\metabolism\types\trapezoid-capsule.gh",
    RemoteSolveVersion=(0, 1, 0),
    ShowInput_Enabled=True,
    ShowInput_Path=True,
    SynchronousSolve=False)
por = ModelPort(Port=trim)  # -> Port, Valid, Id, Description, Point, Direction, Locators; disabled
merge_4 = Merge(Data1=hops_10, Data2=hops_12, Data3=hops_19, Data4=hops_28)
hops_38 = Hops(
    _Path=item_2.Item4,
    _Enabled=toggle_3,
    Variant="L",
    CacheResultsInMemory=True,
    CacheSolveResults=True,
    RemoteDefinitionLocation="C:\git\semio\examples\metabolism\types\capsule-with-balcony.gh",
    RemoteSolveVersion=(0, 1, 0),
    ShowInput_Enabled=True,
    ShowInput_Path=True,
    SynchronousSolve=False)
hops_39 = Hops(
    _Path=item_2.Item5,
    _Enabled=toggle_3,
    Variant="L",
    CacheResultsInMemory=True,
    CacheSolveResults=True,
    RemoteDefinitionLocation="C:\git\semio\examples\metabolism\types\capsule.gh",
    RemoteSolveVersion=(0, 1, 0),
    ShowInput_Enabled=True,
    ShowInput_Path=True,
    SynchronousSolve=False)
hops_40 = Hops(
    _Path=item_2.Item8,
    _Enabled=toggle_3,
    Variant="L",
    CacheResultsInMemory=True,
    CacheSolveResults=True,
    RemoteDefinitionLocation="C:\git\semio\examples\metabolism\types\ellipsoid-capsule.gh",
    RemoteSolveVersion=(0, 1, 0),
    ShowInput_Enabled=True,
    ShowInput_Path=True,
    SynchronousSolve=False)
hops_41 = Hops(
    _Path=item_2.Item10,
    _Enabled=toggle_3,
    Variant="L",
    CacheResultsInMemory=True,
    CacheSolveResults=True,
    RemoteDefinitionLocation="C:\git\semio\examples\metabolism\types\trapezoid-capsule.gh",
    RemoteSolveVersion=(0, 1, 0),
    ShowInput_Enabled=True,
    ShowInput_Path=True,
    SynchronousSolve=False)
panel_3 = Panel(por.Point)  # disabled
hops_42 = Hops(
    _Path=item_2.Item4,
    _Enabled=toggle_3,
    Variant="s",
    CacheResultsInMemory=True,
    CacheSolveResults=True,
    RemoteDefinitionLocation="C:\git\semio\examples\metabolism\types\capsule-with-balcony.gh",
    RemoteSolveVersion=(0, 1, 0),
    ShowInput_Enabled=True,
    ShowInput_Path=True,
    SynchronousSolve=False)
hops_43 = Hops(
    _Path=item_2.Item5,
    _Enabled=toggle_3,
    Variant="s",
    CacheResultsInMemory=True,
    CacheSolveResults=True,
    RemoteDefinitionLocation="C:\git\semio\examples\metabolism\types\capsule.gh",
    RemoteSolveVersion=(0, 1, 0),
    ShowInput_Enabled=True,
    ShowInput_Path=True,
    SynchronousSolve=False)
hops_44 = Hops(
    _Path=item_2.Item8,
    _Enabled=toggle_3,
    Variant="s",
    CacheResultsInMemory=True,
    CacheSolveResults=True,
    RemoteDefinitionLocation="C:\git\semio\examples\metabolism\types\ellipsoid-capsule.gh",
    RemoteSolveVersion=(0, 1, 0),
    ShowInput_Enabled=True,
    ShowInput_Path=True,
    SynchronousSolve=False)
hops_45 = Hops(
    _Path=item_2.Item10,
    _Enabled=toggle_3,
    Variant="s",
    CacheResultsInMemory=True,
    CacheSolveResults=True,
    RemoteDefinitionLocation="C:\git\semio\examples\metabolism\types\trapezoid-capsule.gh",
    RemoteSolveVersion=(0, 1, 0),
    ShowInput_Enabled=True,
    ShowInput_Path=True,
    SynchronousSolve=False)
list_2 = ValueList({"Typ(Base)": 0, "Typ(Base,Blob)": 1, "Typ(Bridge)": 2, "Typ(Capital)": 3, "Typ(Cylindric Capital)": 4, "Typ(Capsule,\)": 5, "Typ(Capsule,/)": 6, "Typ(Capsule,q)": 7, "Typ(Capsule,p)": 8, "Typ(Capsule,J)": 9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}, selected=["Typ(Capsule,z)": 12, "Typ(Capsule with Balcony,\)": 13, "Typ(Capsule with Balcony,/)": 14, "Typ(Capsule with Balcony,q)": 15, "Typ(Capsule with Balcony,p)": 16, "Typ(Capsule with Balcony,J)": 17, "Typ(Capsule with Balcony,L)": 18, "Typ(Capsule with Balcony,s)": 19, "Typ(Trapezoid Capsule,J)": 33])
hops_46 = Hops(
    _Path=item_2.Item4,
    _Enabled=toggle_3,
    Variant="z",
    CacheResultsInMemory=True,
    CacheSolveResults=True,
    RemoteDefinitionLocation="C:\git\semio\examples\metabolism\types\capsule-with-balcony.gh",
    RemoteSolveVersion=(0, 1, 0),
    ShowInput_Enabled=True,
    ShowInput_Path=True,
    SynchronousSolve=False)
hops_47 = Hops(
    _Path=item_2.Item5,
    _Enabled=toggle_3,
    Variant="z",
    CacheResultsInMemory=True,
    CacheSolveResults=True,
    RemoteDefinitionLocation="C:\git\semio\examples\metabolism\types\capsule.gh",
    RemoteSolveVersion=(0, 1, 0),
    ShowInput_Enabled=True,
    ShowInput_Path=True,
    SynchronousSolve=False)
hops_48 = Hops(
    _Path=item_2.Item8,
    _Enabled=toggle_3,
    Variant="z",
    CacheResultsInMemory=True,
    CacheSolveResults=True,
    RemoteDefinitionLocation="C:\git\semio\examples\metabolism\types\ellipsoid-capsule.gh",
    RemoteSolveVersion=(0, 1, 0),
    ShowInput_Enabled=True,
    ShowInput_Path=True,
    SynchronousSolve=False)
hops_49 = Hops(
    _Path=item_2.Item10,
    _Enabled=toggle_3,
    Variant="z",
    CacheResultsInMemory=True,
    CacheSolveResults=True,
    RemoteDefinitionLocation="C:\git\semio\examples\metabolism\types\trapezoid-capsule.gh",
    RemoteSolveVersion=(0, 1, 0),
    ShowInput_Enabled=True,
    ShowInput_Path=True,
    SynchronousSolve=False)
ty_2 = Type([null x45])
lng_2 = ListLength(List=ty_2)
series_2 = Series(Start=0, Step=1, Count=lng_2)
concat_12 = Concatenate(FragmentA=ty_2, FragmentC="=", FragmentB=series_2)
panel_4 = Panel(concat_12)
merge_5 = Merge(Data1=hops_6, Data2=hops_14, Data3=hops_20, Data4=hops_24, Data5=hops_35, Data6=hops_39, Data7=hops_43, Data8=hops_47)
merge_6 = Merge(Data1=hops_5, Data2=hops_13, Data3=hops_18, Data4=hops_23, Data5=hops_34, Data6=hops_38, Data7=hops_42, Data8=hops_46)
merge_7 = Merge(Data1=hops_7, Data2=hops_15, Data3=hops_21, Data4=hops_25, Data5=hops_36, Data6=hops_40, Data7=hops_44, Data8=hops_48)
merge_8 = Merge(Data1=hops_8, Data2=hops_16, Data3=hops_22, Data4=hops_26, Data5=hops_37, Data6=hops_41, Data7=hops_45, Data8=hops_49)
merge_9 = Merge(
    Data1=hops_29,
    Data2=hops_30,
    Data3=hops_31,
    Data4=hops_32,
    Data5=hops_33,
    Data6=merge_5,
    Data7=merge_6,
    Data8=merge_7,
    Data9=merge_8,
    Data10=merge_3,
    Data11=merge_4)
txt_3 = DecodeText(EncodedText=merge_9)
typ_3 = DeserializeType(Text=txt_3)
ty_3 = Type(typ_3)

typ_4 = ModelType(Type=ty_2)  # -> Type, Valid, Name, Description, Icon, Image, flatten(Variant), Unit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
panel_5 = Panel(ty_2)

validate = BooleanToggle(False)
ghbkit = GitHubKit(domain="github.com", account="usalu", repo="metabolism", tag="r24.12-2")  # -> remote_2, homepage_2
kt = Kit("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")
panel_6 = Panel("🫀")
ty_4 = Type(ty_2)
dn_3 = Design(dn_2)
kit = ModelKit(
    Validate=validate,
    Name="Metabolism",
    Description="Everything for metabolistic architecture.",
    Icon="icons/metabolism.svg",
    Image="images/metabolism.png",
    Preview="docs/preview.png",
    Version="r24.12-2",
    Remote=ghbkit.remote_2,
    Homepage=ghbkit.homepage_2,
    Types=ty_4,
    Designs=dn_3)  # -> Kit, Valid, Name, Description, Icon, Image, Preview, Version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
kt_2 = Kit(kit.Kit)
kit_2 = ModelKit(Kit=kt)  # -> Kit, Valid, Name, Description, Icon, Image, Preview, Version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
delete_kit = BooleanToggle(False)
create_kit = BooleanToggle(False)
trim_2 = TrimTree(Tree=kit_2.Types, Depth=1)
trim_3 = TrimTree(Tree=kit_2.Designs, Depth=1)
load_kit = BooleanToggle(True)
kit_3 = DeleteKit(Uri=concat_2, Run=delete_kit)
kit_4 = CreateKit(Kit=kit.Kit, Uri=concat_2, Run=create_kit)
kit_5 = LoadKit(Uri=concat_2, Run=load_kit)  # -> Success, Kit, LocalDirectory
kt_3 = Kit(kit_2.Kit)
ty_5 = Type(trim_2)
dn_4 = Design(trim_3)

panel_7 = Panel(typ_4.Description)
txt_4 = EncodeText(Text=concat_2)
panel_8 = Panel(txt_4)

# ----
# Constructors
validate_2 = BooleanToggle(True)

list_3 = ValueList({"Dsn(Nakagin Capsule Tower)": 0, "Dsn(Nakagin Capsule Tower,Slanted)": 1, "Dsn(Nakagin Capsule Tower,Twisted)": 2, "Dsn(Nakagin Capsule Tower,Dancing,Explosion Axonometry)": 3}, selected="Dsn(Nakagin Capsule Tower)")
list_4 = ValueList({"Typ(Base)": 0, "Typ(Base,Blob)": 1, "Typ(Bridge)": 2, "Typ(Capital)": 3, "Typ(Cylindric Capital)": 4, "Typ(Capsule,\)": 5, "Typ(Capsule,/)": 6, "Typ(Capsule,q)": 7, "Typ(Capsule,p)": 8, "Typ(Capsule,J)": 9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}, selected=["Typ(Capsule,\)", "Typ(Capsule,/)", "Typ(Capsule,q)", "Typ(Capsule,p)", "Typ(Capsule,J)", "Typ(Capsule,L)": 10, "Typ(Capsule,s)": 11, "Typ(Capsule,z)": 12, "Typ(Tambour)": 37])

spt = ModelScreenPoint(Validate=validate_2)  # -> ScreenPoint, Valid, X, Y

# ----
# Point missing
# Direction missing
por_2 = ModelPort(Validate=validate_2)  # -> Port, Valid, Id, Point, Direction, Locators, Locators_2

# ----
# Url missing
rep = ModelRepresentation(Validate=validate_2)  # -> Representation, Valid, Url, Mime, Lod, Tags

# ----
# Group missing
loc = ModelLocator(Validate=validate_2)  # -> Locator, Valid, Group, Subgroup

# ----
# Name missing
qal = ModelQuality(Validate=validate_2)  # -> Quality, Valid, Name, Value, Unit, Definition

# ----
# Connected equal Connecting
con = ModelConnection(Validate=validate_2)  # -> Connection, Valid, ConnectedPieceId, ConnectedPieceTypePortId, ConnectingPieceId, ConnectingPieceTypePortId, Rotation, Tilt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

# ----
# Normalization not affecting semantics
item_3 = ListItem(List=dn_4, Index=0, Wrap=True)  # disabled
dsn_2 = NormalizeDesign(dn=item_3)  # disabled
shwdsn = ShowDesign(dn=item_3, ty=ty_5, mm="model/vnd.3dm")  # -> id_2, ur_2, pln_2; disabled
shwdsn_2 = ShowDesign(dn=dsn_2, ty=ty_5, mm="model/vnd.3dm")  # -> id_2, ur_2, pln_2; disabled
tsort = SortText(Keys=shwdsn_2.id_2, Values=shwdsn_2.pln_2, Culture=127)  # -> Keys, Values; disabled
tsort_2 = SortText(Keys=shwdsn.id_2, Values=shwdsn.pln_2, Culture=127)  # -> Keys, Values; disabled
expression = Expression(x=tsort_2.Values, y=tsort.Values, Expression="x=y")  # disabled
mm = MassMultiplication(Input=expression)  # -> Result, PartialResults; disabled
bool = Boolean(mm.Result)  # disabled
must_be_true = Panel(bool)  # disabled

# ----
# Type Name missing
pce = ModelPiece(Validate=validate_2)  # -> Piece, Valid, Id, TypeName, TypeVariant, Plane, DiagramPoint

# ----
# Name missing
typ_5 = ModelType(Validate=validate_2)  # -> Type, Valid, Name, Description, Icon, Variant, Unit, Representations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

# ----
# Name missing
dsn_3 = ModelDesign(Validate=validate_2)  # -> Design, Valid, Name, Description, Icon, Variant, Unit, Pieces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

# ----
# Name missing
kit_6 = ModelKit(Validate=validate_2)  # -> Kit, Valid, Name, Description, Icon, Version, Remote, Homepage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

item_4 = ListItem(List=ty_5, Index=list_4, Wrap=True)
item_5 = ListItem(List=ty_5, Index=list_4, Wrap=True)
panel_9 = Panel("IdToooooooooooooooooooooooooooooooooooooooLooooooooooooooooooooooooooooooooooooooooooooooooooongggggggggggggggggggggggggggggggggg")
panel_10 = Panel("NameToooooooooooooooooLoooooooooooooooooooooonggggggggggggggggggg")
panel_11 = Panel("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")
dsn_4 = PredictDesign(Description="Tambour with a capsule on every door.", Types=item_4, Run=Toggle(False))  # -> Success, Design
dsn_5 = PredictDesign(Description="A stack of ten tambours with a capsule on every door.", Types=item_5, Run=Toggle(False))  # -> Success, Design
panel_12 = Panel("SecondName")
dam = DataDam(DataA=dsn_4.Design, BufferDelay=10000000, BufferMode=0)
dam_2 = DataDam(DataA=dsn_5.Design, BufferDelay=10000000, BufferMode=0)

# ----
# Id too long
pt = ConstructPoint(XCoordinate=0, YCoordinate=0, ZCoordinate=0)
X = UnitX(Factor=1)
por_3 = ModelPort(Validate=validate_2, Id=panel_9, Point=pt, Direction=X)  # -> Port, Valid, Id, Point, Direction, Locators, Locators_2

# ----
# Url too long
rep_2 = ModelRepresentation(Validate=validate_2, Url="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")  # -> Representation, Valid, Url, Mime, Lod, Tags

# ----
# Lod too long
rep_3 = ModelRepresentation(Validate=validate_2, Url="https://url", Mime="https://url", Lod=panel_10)  # -> Representation, Valid, Url, Mime, Lod, Tags

# ----
# Description too long
typ_6 = ModelType(Validate=validate_2, Name="Name", Description=panel_11)  # -> Type, Valid, Name, Description, Icon, Variant, Unit, Representations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

# ----
# Props
# Tag too long
rep_4 = ModelRepresentation(Validate=validate_2, Url="https://url", Mime="https://url", Tags=panel_10)  # -> Representation, Valid, Url, Mime, Lod, Tags

# ----
# Id too long
pce_2 = ModelPiece(Validate=validate_2, Id=panel_9, TypeName="Name")  # -> Piece, Valid, Id, TypeName, TypeVariant, Plane, ScreenPoint

# ----
# Description too long
dsn_6 = ModelDesign(Validate=validate_2, Name="Name", Description=panel_11)  # -> Design, Valid, Name, Description, Icon, Variant, Unit, Pieces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

# ----
# Mime too long
rep_5 = ModelRepresentation(Validate=validate_2, Url="https://url", Mime=panel_9)  # -> Representation, Valid, Url, Mime, Lod, Tags

# ----
# Description too long
kit_7 = ModelKit(Validate=validate_2, Name="Name", Description=panel_11)  # -> Kit, Valid, Name, Description, Icon, Version, Remote, Homepage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

# ----
# Connected equal Connecting
con_2 = ModelConnection(Validate=validate_2, ConnectedPieceId="0", ConnectingPieceId="0")  # -> Connection, Valid, ConnectedPieceId, ConnectedPieceTypePortId, ConnectingPieceId, ConnectingPieceTypePortId, Rotation, Tilt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

# ----
# Piece not part
con_3 = ModelConnection(ConnectedPieceId="0", ConnectingPieceId="1")  # -> Connection, Valid, ConnectedPieceId, ConnectedPieceTypePortId, ConnectingPieceId, ConnectingPieceTypePortId, Rotation, Tilt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
dsn_7 = ModelDesign(Validate=validate_2, Name="Name", Connections=con_3.Connection)  # -> Design, Valid, Name, Description, Icon, Image, Variant, View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

panel_13 = Panel("1ef59aec9f6d93a2878d3771c6401209c9ba597c")
panel_14 = Panel("main-tag")
# UserObjects
panel_15 = Panel("usalu")
ghbkit_2 = GitHubKit(domain="github.com", account="metabolism", repo="main", branch="main")  # -> remote_2, homepage_2
panel_16 = Panel(ghbkit_2.remote_2)
panel_17 = Panel(ghbkit_2.homepage_2)
panel_18 = Panel("https://github.com/usalu/metabolism/archive/1ef59aec9f6d93a2878d3771c6401209c9ba597c.zip")
panel_19 = Panel("https://github.com/usalu/metabolism/tree/1ef59aec9f6d93a2878d3771c6401209c9ba597c")

panel_20 = Panel("Slanted")
panel_21 = Panel("Twisted")
dn_5 = Design(dn_4)
seldsn = SelectDesign(dn=dn_5, na="Nakagin Capsule Tower")
seldsn_2 = SelectDesign(dn=dn_5, na="Nakagin Capsule Tower", variant="Dancing", view="Explosion Axonometry")
seldsn_3 = SelectDesign(dn=dn_5, na="Nakagin Capsule Tower")
seldsn_4 = SelectDesign(dn=dn_5, na="Nakagin Capsule Tower")

toggle_4 = BooleanToggle(True)

# ----
# Creating Kit without losing information
kit_8 = DeleteKit(Url=concat_2, Run=toggle_4)  # disabled
kt_4 = Kit(kt_3)  # disabled
expression_2 = Expression(x=toggle_4, y=kit_8, Expression="x")  # disabled
kit_9 = SerializeKit(Kit=kt_4)  # disabled
kit_10 = CreateKit(Kit=kt_4, Uri=concat_2, Run=False)  # disabled
expression_3 = Expression(x=toggle_4, y=kit_10, Expression="x")  # disabled
kit_11 = LoadKit(Uri=concat_2, Run=expression_3)  # -> Success, Kit, LocalDirectory; disabled
kit_12 = SerializeKit(Kit=kit_11.Kit)  # disabled
expression_4 = Expression(x=kit_9, y=kit_12, Expression="x=y")  # disabled
must_be_true_2 = Panel(expression_4)  # disabled

# ----
# Overwrite types and designs
expression_5 = Expression(x=toggle_4, y=must_be_true_2, Expression="x")  # disabled
kt_5 = Kit(kt_3)  # disabled
kit_13 = ModelKit(Kit=kt_5)  # -> Kit, Valid, Name, Description, Icon, Version, Remote, Homepage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; disabled
kit_14 = DeleteKit(Url=concat_2, Run=expression_5)  # disabled
expression_6 = Expression(x=expression_5, y=kit_14, Expression="x")  # disabled
trim_4 = TrimTree(Tree=kit_13.Types, Depth=1)  # disabled
trim_5 = TrimTree(Tree=kit_13.Designs, Depth=1)  # disabled
kit_15 = NormalizeKit(kt=kt_5)  # disabled
kit_16 = CreateKit(Kit=kt_5, Uri=concat_2, Run=False)  # disabled
typ_7 = PutType(Type=trim_4, Uri=concat_2, Run=False)  # disabled
dsn_8 = PutDesign(Design=trim_5, Uri=concat_2, Run=False)  # disabled
kit_17 = SerializeKit(Kit=kit_15)  # disabled
expression_7 = Expression(x=expression_5, y=kit_16, Expression="x")  # disabled
item_6 = ListItem(List=typ_7, Index=0, Wrap=True)  # disabled
expression_8 = Expression(x=expression_5, y=item_6, Expression="x")  # disabled
item_7 = ListItem(List=dsn_8, Index=0, Wrap=True)  # disabled
kit_18 = LoadKit(Uri=concat_2, Run=expression_7)  # -> Success, Kit, LocalDirectory; disabled
expression_9 = Expression(x=expression_5, y=kit_18.Success, Expression="x")  # disabled
expression_10 = Expression(x=expression_5, y=item_7, Expression="x")  # disabled
kit_19 = LoadKit(Uri=concat_2, Run=expression_10)  # -> Success, Kit, LocalDirectory; disabled
kit_20 = NormalizeKit(kt=kit_19.Kit)  # disabled
kit_21 = SerializeKit(Kit=kit_20)  # disabled
expression_11 = Expression(x=kit_17, y=kit_21, Expression="x=y")  # disabled
must_be_true_3 = Panel(expression_11)  # disabled

and = GateAnd(A=must_be_true_2, B=must_be_true_3, C=must_be_true_2)  # disabled
must_be_true_4 = Panel(and)  # disabled

# ==== cluster ShowDesign: Show a design by flattening it and selecting only representations with the same mime, lod and tags.
ty = ClusterInput()
dn = ClusterInput()
mm = ClusterInput()
lod = ClusterInput()
tags = ClusterInput()
ty_2 = Type(ty)
mm_2 = Mime(mm)
tags_2 = Tags(tags)
dn_2 = Design(dn)
lod_2 = Lod(lod)
fltdsn = FlattenDesign(Design=dn_2, Type=ty_2)
typ = ModelType(Type=ty_2)  # -> Type, Valid, Name, Description, Icon, Variant, Unit, Representations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
dsn = ModelDesign(Design=fltdsn)  # -> Design, Valid, Name, Description, Icon, Variant, Unit, Pieces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
tstat = TreeStatistics(Tree=typ.Representations)  # -> Paths, Length, Count
trim = TrimTree(Tree=dsn.Pieces, Depth=1)
pce = ModelPiece(Piece=trim)  # -> Piece, Valid, Id, TypeName, TypeVariant, Plane, ScreenPoint
lng = ListLength(List=ty_2)
expression = Expression(x=graft(pce.TypeName), y=typ.Name, Expression="x=y")
expression_2 = Expression(x=graft(pce.TypeVariant), y=typ.Variant, Expression="x=y")
series = Series(Start=0, Step=1, Count=lng)
and = GateAnd(A=expression, B=expression_2)
trim_2 = TrimTree(Tree=series, Depth=1)
cull = CullPattern(List=ty_2, CullPattern=and)
txt = Text(cull)
txt_2 = Text(ty_2)
expression_3 = Expression(x=txt, y=txt_2, Expression="x=y")
cull_2 = CullPattern(List=trim_2, CullPattern=expression_3)
trim_3 = TrimTree(Tree=cull_2, Depth=1)
item = ListItem(List=tstat.Paths, Index=trim_3, Wrap=True)
branch = TreeBranch(Tree=typ.Representations, Path=item, MaintainPaths=False)
mrg_p = MergeSeperatlyPrepend(x=branch)  # -> Mrgd; inputs x: tree
# ---------- mrg_p: Python ----------
if ghenv.Component.RunCount<2:
    __author__ = "Ueli Saluz"
    __version__ = "2020.05.28"
    
    ghenv.Component.Name = "MergeSeperatly(Prepend)"
    ghenv.Component.NickName = "Mrg(P)"
    ghenv.Component.Description = "Merge inputs seperatly on a new path. Prepend index of input parameter for distincting."
    ghenv.Component.Message = "VER 1.0"

from System import Object
from Grasshopper import DataTree
from Grasshopper.Kernel import GH_ParamAccess as Access

if __name__ == "__main__":
    Mrgd = DataTree[Object]()
    access = Access()
    
    for input in ghenv.Component.Params.Input:  #set all Inputaccess to Tree Access
        input.Access = access.tree
    
    for i,input in enumerate(ghenv.Component.Params.Input):
        for j,source in enumerate(input.Sources):
            for path in source.VolatileData.Paths:
                Mrgd.AddRange(source.VolatileData[path],path.PrependElement(i))
# ---------- end mrg_p ----------
rep = ModelRepresentation(Representation=mrg_p)  # -> Representation, Valid, Url, Mime, Lod, Tags
expression_4 = Expression(x=rep.Mime, y=mm_2, Expression="x=y")
cull_3 = CullPattern(List=rep.Representation, CullPattern=expression_4)
rep_2 = ModelRepresentation(Representation=cull_3)  # -> Representation, Valid, Url, Mime, Lod, Tags
expression_5 = Expression(x=rep_2.Lod, y=lod_2, Expression="x=y")
cull_4 = CullPattern(List=rep_2.Representation, CullPattern=expression_5)
trim_4 = TrimTree(Tree=cull_4, Depth=1)
rep_3 = ModelRepresentation(Representation=trim_4)  # -> Representation, Valid, Url, Mime, Lod, Tags
ur = Url(rep_3.Url)
id = Id(pce.Id)
pln = Plane(pce.Plane)
ur_2 = ClusterOutput(ur)
pln_2 = ClusterOutput(pln)
id_2 = ClusterOutput(id)

# ==== cluster NormalizeDesign: Normalize a design for this document. This includes changing the unit to the document unit and rescaling the affected values. Further it reoders pieces, connections and qualities. Connections might be swapped, so that the connected piece id is lexically first.
dn = ClusterInput()
dn_2 = Design(graft(dn))
dsn = ModelDesign()  # -> Design, Valid, Name, Description, Icon, Variant, Unit, Pieces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
dsn_2 = ModelDesign(Design=dn_2)  # -> Design, Valid, Name, Description, Icon, Variant, Unit, Pieces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
trim = TrimTree(Tree=dsn_2.Pieces, Depth=1)
trim_2 = TrimTree(Tree=dsn_2.Qualities, Depth=1)
trim_3 = TrimTree(Tree=dsn_2.Connections, Depth=1)
cnvunt = ConvertUnit(Value=1, FromUnit=dsn_2.Unit, ToUnit=dsn.Unit)
con = ModelConnection(Connection=trim_3)  # -> Connection, Valid, ConnectedPieceId, ConnectedPieceTypePortId, ConnectingPieceId, ConnectingPieceTypePortId, Rotation, Tilt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
multiplication = Multiplication(A=con.Gap, B=cnvunt)
multiplication_2 = Multiplication(A=con.Shift, B=cnvunt)
con_2 = ModelConnection(Connection=con.Connection, Gap=multiplication, Shift=multiplication_2)  # -> Connection, Valid, ConnectedPieceId, ConnectedPieceTypePortId, ConnectingPieceId, ConnectingPieceTypePortId, Rotation, Tilt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
merge = Merge(Data1=graft(con_2.ConnectedPieceId), Data2=graft(con_2.ConnectingPieceId))
tsort = SortText(Keys=merge, Culture=127)  # -> Keys, Values
trim_4 = TrimTree(Tree=tsort.Keys, Depth=1)
expression = Expression(x=merge, y=trim_4, Expression="x=y")
item = ListItem(List=expression, Index=0, Wrap=True)
trim_5 = TrimTree(Tree=item, Depth=1)
dispatch = Dispatch(List=con_2.Connection, DispatchPattern=trim_5)  # -> ListA, ListB
con_3 = ModelConnection(Connection=dispatch.ListB)  # -> Connection, Valid, ConnectedPieceId, ConnectedPieceTypePortId, ConnectingPieceId, ConnectingPieceTypePortId, Rotation, Tilt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
con_4 = ModelConnection(
    Connection=dispatch.ListB,
    ConnectedPieceId=con_3.ConnectingPieceId,
    ConnectedPieceTypePortId=con_3.ConnectingPieceTypePortId,
    ConnectingPieceId=con_3.ConnectedPieceId,
    ConnectingPieceTypePortId=con_3.ConnectedPieceTypePortId)  # -> Connection, Valid, ConnectedPieceId, ConnectedPieceTypePortId, ConnectingPieceId, ConnectingPieceTypePortId, Rotation, Tilt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
merge_2 = Merge(Data1=dispatch.ListA, Data2=con_4.Connection)
con_5 = ModelConnection(Connection=merge_2)  # -> Connection, Valid, ConnectedPieceId, ConnectedPieceTypePortId, ConnectingPieceId, ConnectingPieceTypePortId, Rotation, Tilt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
concat = Concatenate(FragmentA=con_5.ConnectedPieceId, FragmentC="##", FragmentB=con_5.ConnectingPieceId)
qal = ModelQuality(Quality=trim_2)  # -> Quality, Valid, Name, Value, Unit, Definition
pce = ModelPiece(Piece=trim)  # -> Piece, Valid, Id, TypeName, TypeVariant, Plane, ScreenPoint
tsort_2 = SortText(Keys=concat, Values=con_5.Connection, Culture=127)  # -> Keys, Values
tsort_3 = SortText(Keys=qal.Name, Values=qal.Quality, Culture=127)  # -> Keys, Values
tsort_4 = SortText(Keys=pce.Id, Values=pce.Piece, Culture=127)  # -> Keys, Values
trim_6 = TrimTree(Tree=tsort_2.Values, Depth=1)
trim_7 = TrimTree(Tree=tsort_3.Values, Depth=1)
trim_8 = TrimTree(Tree=tsort_4.Values, Depth=1)
dsn_3 = ModelDesign(Design=dsn_2.Design, Unit=dsn.Unit, Pieces=trim_8, Connections=trim_6, Qualities=trim_7)  # -> Design, Valid, Name, Description, Icon, Variant, Unit, Pieces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
trim_9 = TrimTree(Tree=dsn_3.Design, Depth=1)
dn_3 = Design(trim_9)
dn_4 = ClusterOutput(dn_3)

# ==== cluster NormalizeKit: Normalize a kit to this document. This normalizes all types and designs and reorders them according their name and variant
kt = ClusterInput()
kt_2 = Kit(graft(kt))
kit = ModelKit(Kit=kt_2)  # -> Kit, Valid, Name, Description, Icon, Version, Remote, Homepage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
trim = TrimTree(Tree=kit.Designs, Depth=1)
trim_2 = TrimTree(Tree=kit.Types, Depth=1)
dsn = NormalizeDesign(dn=trim)
typ = NormalizeType(ty=trim_2)
typ_2 = ModelType(Type=typ)  # -> Type, Valid, Name, Description, Icon, Variant, Unit, Representations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
dsn_2 = ModelDesign(Design=dsn)  # -> Design, Valid, Name, Description, Icon, Variant, Unit, Pieces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
concat = Concatenate(FragmentA=typ_2.Name, FragmentB="##", FragmentC=typ_2.Variant)
concat_2 = Concatenate(FragmentA=dsn_2.Name, FragmentB="##", FragmentC=dsn_2.Variant)
tsort = SortText(Keys=concat, Values=typ_2.Type, Culture=127)  # -> Keys, Values
tsort_2 = SortText(Keys=concat_2, Values=dsn_2.Design, Culture=127)  # -> Keys, Values
trim_3 = TrimTree(Tree=tsort.Values, Depth=1)
trim_4 = TrimTree(Tree=tsort_2.Values, Depth=1)
kit_2 = ModelKit(Kit=kit.Kit, Types=trim_3, Designs=trim_4)  # -> Kit, Valid, Name, Description, Icon, Version, Remote, Homepage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
trim_5 = TrimTree(Tree=kit_2.Kit, Depth=1)
kt_3 = Kit(trim_5)
kt_4 = ClusterOutput(kt_3)

# ==== cluster GitHubKit: Get the uri and the homepage of the remote kit of a specific version (either a branch name, a tag name or a commit sha) for a kit hosted as a repository on GitHub.
domain = ClusterInput()
account = ClusterInput()
repo = ClusterInput()
branch = ClusterInput()
tag = ClusterInput()
commit = ClusterInput()
commit_2 = Text(commit)
domain_2 = Text(domain)
account_2 = Text(account)
repo_2 = Text(repo)
branch_2 = Text(branch)
tag_2 = Text(tag)
null = NullItem(Item=domain_2)  # -> NullFlags, InvalidFlags, Description

null_2 = NullItem(Item=tag_2)  # -> NullFlags, InvalidFlags, Description
null_3 = NullItem(Item=commit_2)  # -> NullFlags, InvalidFlags, Description
null_4 = NullItem(Item=branch_2)  # -> NullFlags, InvalidFlags, Description
not = GateNot(A=null_2.NullFlags)
not_2 = GateNot(A=null_3.NullFlags)
not_3 = GateNot(A=null_4.NullFlags)
merge = Merge(Data1=not_3, Data2=not, Data3=not_2)
int = Integer(merge)
ma = MassAddition(Input=int)  # -> Result, PartialResults
expression = Expression(x=ma.Result, Expression="x≠1")
null_5 = NullItem(Item=account_2)  # -> NullFlags, InvalidFlags, Description
null_6 = NullItem(Item=repo_2)  # -> NullFlags, InvalidFlags, Description
or = GateOr(A=expression, D=null.NullFlags, B=null_5.NullFlags, C=null_6.NullFlags)

filter = StreamFilter(Gate=null_4.NullFlags, Stream0="heads", Stream1="tags")
filter_2 = StreamFilter(Gate=null_4.NullFlags, Stream0=branch_2, Stream1=tag_2)
concat = Concatenate(FragmentA="https://", FragmentE=domain_2, FragmentF="/", FragmentB=account_2, FragmentC="/", FragmentD=repo_2)
concat_2 = Concatenate(FragmentA="refs/", FragmentB=filter, FragmentC="/")
filter_3 = StreamFilter(Gate=null_3.NullFlags, Stream1=concat_2)
filter_4 = StreamFilter(Gate=null_3.NullFlags, Stream0=commit_2, Stream1=filter_2)
concat_3 = Concatenate(FragmentA=concat, FragmentE="/archive/", FragmentC=filter_3, FragmentF=filter_4, FragmentG=".zip")
concat_4 = Concatenate(
    FragmentA=concat,
    FragmentB="/",
    FragmentC="tree",
    FragmentF="/",
    FragmentD=branch_2,
    FragmentE=tag_2,
    FragmentG=commit_2)

filter_5 = StreamFilter(Gate=or, Stream0=concat_3)
filter_6 = StreamFilter(Gate=or, Stream0=concat_4)
remote = Remote(filter_5)
homepage = Homepage(filter_6)
remote_2 = ClusterOutput(remote)
homepage_2 = ClusterOutput(homepage)

# ==== cluster SelectDesign: Select a design with a name, an optional variant and an optional view. If no variant is provided it will select all variants. If you want to select the default variant then use the empty text. If no view is provided it will select all views. If you want to select the default view then use the empty text.
dn = ClusterInput()
na = ClusterInput()
variant = ClusterInput()
view = ClusterInput()
dn_2 = Design(dn)
na_2 = Name(na)
variant_2 = Variant(variant)
view_2 = View(view)
dsn = ModelDesign(Design=dn_2)  # -> Design, Valid, Name, Description, Icon, Image, Variant, View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
expression = Expression(x=dsn.Name, y=na_2, Expression="x=y")
cull = CullPattern(List=dsn.Design, CullPattern=expression)
dsn_2 = ModelDesign(Design=cull)  # -> Design, Valid, Name, Description, Icon, Image, Variant, View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
expression_2 = Expression(x=dsn_2.Variant, y=variant_2, Expression="x=y")
null = NullItem(Item=view_2)  # -> NullFlags, InvalidFlags, Description
cull_2 = CullPattern(List=dsn_2.Design, CullPattern=expression_2)
dsn_3 = ModelDesign(Design=cull_2)  # -> Design, Valid, Name, Description, Icon, Image, Variant, View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
expression_3 = Expression(x=dsn_3.View, y=view_2, Expression="x=y")
cull_3 = CullPattern(List=dsn_3.Design, CullPattern=expression_3)
filter = StreamFilter(Gate=null.NullFlags, Stream0=cull_3, Stream1=cull_2)
null_2 = NullItem(Item=variant_2)  # -> NullFlags, InvalidFlags, Description
filter_2 = StreamFilter(Gate=null_2.NullFlags, Stream0=filter, Stream1=cull)
dn_3 = Design(filter_2)
dn_4 = ClusterOutput(dn_3)

# ==== cluster NormalizeType: Normalize a type for this document. This converts the length unit of the type to the length unit of this document and it scales the ports by the right scaling factor. Further it sorts the representations, ports, qualities by it's keys.
ty = ClusterInput()
ty_2 = Type(graft(ty))
typ = ModelType()  # -> Type, Valid, Name, Description, Icon, Variant, Unit, Representations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
typ_2 = ModelType(Type=ty_2)  # -> Type, Valid, Name, Description, Icon, Variant, Unit, Representations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
cnvunt = ConvertUnit(Value=1, FromUnit=typ_2.Unit, ToUnit=typ.Unit)
trim = TrimTree(Tree=typ_2.Ports, Depth=1)
trim_2 = TrimTree(Tree=typ_2.Representations, Depth=1)
trim_3 = TrimTree(Tree=typ_2.Qualities, Depth=1)
rep = ModelRepresentation(Representation=trim_2)  # -> Representation, Valid, Url, Mime, Lod, Tags
por = ModelPort(Port=trim)  # -> Port, Valid, Id, Point, Direction, Locators, Locators_2
qal = ModelQuality(Quality=trim_3)  # -> Quality, Valid, Name, Value, Unit, Definition
scale = Scale(Geometry=por.Point, Center=Point(0, 0, 0), Factor=cnvunt)  # -> Geometry, Transform
concat = Concatenate(FragmentA=rep.Mime, FragmentC="##", FragmentB=rep.Lod)
scale_2 = Scale(Geometry=por.Direction, Center=Point(0, 0, 0), Factor=cnvunt)  # -> Geometry, Transform
join = TextJoin(Text=rep.Tags, Join="##")
tsort = SortText(Keys=qal.Name, Values=qal.Quality, Culture=127)  # -> Keys, Values
por_2 = ModelPort(Port=por.Port, Point=scale.Geometry, Direction=scale_2.Geometry)  # -> Port, Valid, Id, Point, Direction, Locators, Locators_2
concat_2 = Concatenate(FragmentA=graft(concat), FragmentB=join)
trim_4 = TrimTree(Tree=tsort.Values, Depth=1)
trim_5 = TrimTree(Tree=concat_2, Depth=1)
tsort_2 = SortText(Keys=por_2.Id, Values=por_2.Port, Culture=127)  # -> Keys, Values
trim_6 = TrimTree(Tree=tsort_2.Values, Depth=1)
tsort_3 = SortText(Keys=trim_5, Values=rep.Representation, Culture=127)  # -> Keys, Values
trim_7 = TrimTree(Tree=tsort_3.Values, Depth=1)
typ_3 = ModelType(Type=typ_2.Type, Unit=typ.Unit, Representations=trim_7, Ports=trim_6, Qualities=trim_4)  # -> Type, Valid, Name, Description, Icon, Variant, Unit, Representations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
trim_8 = TrimTree(Tree=typ_3.Type, Depth=1)
ty_3 = Type(trim_8)
ty_4 = ClusterOutput(ty_3)
